# Grasshopper definition Adder_hops.gh (Grasshopper 1.0.7)

int = GetInteger(Slider(10, range=0..10), AtLeast=1, AtMost=1, Maximum=2147483647, Minimum=-2147483648)
int_2 = GetInteger(Slider(10, range=0..10), AtLeast=1, AtMost=1, Maximum=2147483647, Minimum=-2147483648)

# ---- group: Adder
addition = Addition(A=int, B=int_2)

# ---- group: RH_OUT:o
int_3 = Integer(addition)
